# Grasshopper definition assembled_speckle.gh (Grasshopper 1.0.7)
# plug-ins: eleFront, Speckle 2, treesloth01, Pufferfish

# ---- group: BIMSC-PROJECT
# Send a message to James M. to add
# new materials. This list will be updated
# for all groups to have a common material
# library and common material names.
panel = Panel("ELEMENTAL MARS")
bimsc_project = Text(panel)

# ---- group: FLOOR_LEVELS
# Set your 'Project' name, your 'Group'
# number, your 'Volume' Location that
# connect wirelessly.
series = Series(Start=0, Step=1, Count="5")
expression = Expression(x=series, Expression="Format(\"{0:00}\", x)")
concat = Concatenate(FragmentA="L", FragmentB=expression)  # -> simplify(graft(Result))
floor_levels = Text(concat)

# ---- group: RECEIVE MATERIALS
# RECIEVE
# MATERIALS
panel_2 = Panel("https://macad.speckle.xyz/streams/4975f9f0a8/branches/site%2F05-materials")
receive = Receive(
    Stream=panel_2,
    AutoReceive=False,
    CurrentComponentState="up_to_date",
    ExpandOutput=True,
    LastInfoMessage="James McBennett @ 03/02/2024 01:57:29: Materials 01-03-2024 (id:6ecf38526e)",
    ReceiveOnOpen=False,
    ReceivedCommitId="6ecf38526e",
    StreamWrapper="https://macad.speckle.xyz/streams/4975f9f0a8/branches/site/05-materials",
    selectedKitName="Objects")  # -> Info, Materials
dso = DeconstructSpeckleObject(SpeckleObject=receive.Materials, selectedKitName="Objects")  # -> Glass, Inflatable, Insulation, Mineral, Regolith, Site, Soil, Steel

# ----
# filter terrain
# add actual units
panel_3 = Panel("Contours")  # disabled
panel_4 = Panel("TopoBrep")  # disabled
panel_5 = Panel("TopoMesh")  # disabled
panel_6 = Panel("BakedStudioMarsTopoMain")  # disabled
list = ValueList({"AngularDimension", "Arc", "Block", "Brep", "Circle", "Curve", "Dimension", "Ellipse", "Extrusion", "Hatch", "Leader", "Line", "LinearDimension", "Mesh", "Point", "Polyline", "Polysurface", "RadialDimension", "Surface", "Text", "TextDot"}, selected="Mesh")  # disabled
reflay = ReferenceByLayer(LayerName=panel_3, lightweight=False)  # disabled
reflay_2 = ReferenceByLayer(LayerName=panel_4, lightweight=False)  # disabled
reflay_3 = ReferenceByLayer(LayerName=panel_5, lightweight=False)  # disabled
reflay_4 = ReferenceByLayer(LayerName=panel_6, lightweight=False)  # disabled
mesh = MeshBrep(
    Brep=reflay_2,
    Settings={GridMaxCount=0, GridMinCount=16, JaggedSeams=False, MaxEdgeLength=0, MinEdgeLength=0.0001, MinTolerance=0, Refine=True, RefineAngle=0, RelativeTolerance=0.65, SimplePlanes=True, Tolerance=0})  # disabled
brep = Brep(reflay_2)  # disabled
filtertype = FilterByType(ObjectType=list, Geometry=reflay_4, invertFilter=False, returnNulls=False)  # -> ExcludedGeometry, IncludedGeometry; disabled
mesh_2 = Mesh(reflay_3)  # disabled
faceb = FaceBoundaries(Mesh=mesh_2)  # disabled
mesh_3 = Mesh(filtertype.IncludedGeometry)  # disabled
faceb_2 = FaceBoundaries(Mesh=mesh_3)  # disabled
boundary = BoundarySurfaces(Edges=faceb)  # disabled
boundary_2 = BoundarySurfaces(Edges=faceb_2)  # disabled
join = BrepJoin(Breps=boundary)  # -> Breps, Closed; disabled
join_2 = BrepJoin(Breps=boundary_2)  # -> Breps, Closed; disabled

# ---- group: BIMSC-ORIGINATOR
bimsc_originator = Text("G06")

# ---- group: WorksForBrepsAndMeshes
list_2 = ValueList({"Srf/Brep": 0, "Mesh": 1}, selected="Mesh")

# ---- group: BIMSC-VOLUME
bimsc_volume = Text("A4")

# ----
reflay_5 = ReferenceByLayer(LayerName="UnitsRawVolumes", lightweight=False)

# ----
# UNITS
volume = Volume(Geometry=reflay_5)  # -> Volume, Centroid
int = Integer(volume.Volume)
cset = CreateSet(List=int)  # -> Set, Map
cset_2 = CreateSet(List=cset.Map)  # -> Set, Map
mindex = MemberIndex(Set=cset.Map, Member=cset_2.Set)  # -> Index, Count
item = ListItem(List=reflay_5, Index=mindex.Index, Wrap=True)  # -> simplify(Item)
bang = ExplodeTree(Data=item)  # -> Branch0, Branch1

area = Area(Geometry=bang.Branch1)  # -> Area, Centroid
prox = Proximity3D(Points=area.Centroid, Group="1", MaxRadius="5")  # -> simplify(Links), Topology
clean = CleanTree(RemoveNulls=True, RemoveInvalid=True, RemoveEmpty=True, Tree=prox.Links)
tstat = TreeStatistics(Tree=clean)  # -> Paths, Length, Count
split = SplitTree(Data=simplify(graft(bang.Branch1)), Masks=flatten(tstat.Paths))  # -> flatten(Positive), flatten(Negative)

item_2 = ListItem(List=bang.Branch0, Index=0, Wrap=True)
item_3 = ListItem(List=split.Negative, Index="0", Wrap=True)

renumber = RenumberPaths(Data=clean)
end = EndPoints(Curve=renumber)  # -> Start, End
pdecon = Deconstruct(Point=[end.Start, end.End])  # -> XComponent, YComponent, ZComponent
int_2 = Integer(pdecon.ZComponent)
bnd = Bounds(Numbers=int_2)
dedomain = DeconstructDomain(Domain=bnd)  # -> Start, End
equals = Equality(FirstNumber=int_2, SecondNumber=dedomain.Start)  # -> Equality, Inequality
subtraction = Subtraction(A=dedomain.Start, B=dedomain.End)
cull = CullPattern(List=[end.Start, end.End], CullPattern=equals.Equality)
division = Division(A=subtraction, B="2")
abs = Absolute(Value=subtraction)
Z = UnitZ(Factor=division)
wires = BrepWireframe(Brep=split.Positive, Density=-1)
move = Move(Geometry=cull, Motion=Z)  # -> Geometry, Transform
project = Project(Geometry=wires, Plane=move.Geometry)  # -> simplify(Geometry), Transform

end_2 = EndPoints(Curve=project.Geometry)  # -> Start, End
multiplication = Multiplication(A=abs, B="2")
cullpt = CullDuplicates(Points=[end_2.Start, end_2.End], Tolerance=0.1, CullMode=3)  # -> Points, Indices, Valence
pline = PolyLine(Vertices=cullpt.Points, Closed=True)  # -> simplify(Polyline)
Z_2 = UnitZ(Factor=multiplication)
extr = Extrude(Base=pline, Direction=Z_2)
cap = CapHoles(Brep=extr)

volume_2 = Volume(Geometry=bang.Branch0)  # -> Volume, Centroid
group = Group()

# ---- group: units centroids
pt = Point(volume_2.Centroid)

# ----
group_2 = Group()
group_3 = Group()

# ----
# Phasing
# PHASE 2 - HUMANS / MACHINE COLLABORATION
number_slider = Slider(7, range=1..7)
# PHASE 1 - NO HUMANS
series_2 = Series(Start=1, Step=1, Count=number_slider)
item_4 = ListItem(List=series_2, Index=0, Wrap=True)  # -> Item, Item1, Item2, Item3, Item4, Item5, Item6

# ---- group: PHASE
num = Number(item_4.Item3)

num_2 = Number(item_4.Item2)

# FLOORS
num_3 = Number(item_4.Item)

num_4 = Number(item_4.Item1)

num_5 = Number(item_4.Item4)

num_6 = Number(item_4.Item5)

# UNITS
num_7 = Number(item_4.Item6)

# ----
reflay_6 = ReferenceByLayer(LayerName="Floors", lightweight=False, DisableAutoUpdate=False)
panel_7 = Panel(reflay_6)
mesh_4 = MeshBrep(
    Brep=reflay_6,
    Settings={GridMaxCount=0, GridMinCount=16, JaggedSeams=False, MaxEdgeLength=0, MinEdgeLength=0.0001, MinTolerance=0, Refine=True, RefineAngle=0, RelativeTolerance=0.65, SimplePlanes=True, Tolerance=0})
brep_2 = Brep(reflay_6)
mjoin = MeshJoin(Meshes=mesh_4)
weld = WeldMesh(Mesh=mjoin, Angle=3.141592654)

# ----
# WALLS
panel_8 = Panel("Wall")
reflay_7 = ReferenceByLayer(LayerName=panel_8, lightweight=False, DisableAutoUpdate=False)
panel_9 = Panel(reflay_7)
mesh_5 = MeshBrep(
    Brep=reflay_7,
    Settings={GridMaxCount=0, GridMinCount=16, JaggedSeams=False, MaxEdgeLength=0, MinEdgeLength=0.0001, MinTolerance=0, Refine=True, RefineAngle=0, RelativeTolerance=0.65, SimplePlanes=True, Tolerance=0})
brep_3 = Brep(reflay_7)
mjoin_2 = MeshJoin(Meshes=mesh_5)
weld_2 = WeldMesh(Mesh=mjoin_2, Angle=3.141592654)

# ----
# ROOFS
panel_10 = Panel("Roof")
reflay_8 = ReferenceByLayer(LayerName=panel_10, lightweight=False, DisableAutoUpdate=False)
panel_11 = Panel(reflay_8)
mesh_6 = Mesh(reflay_8)
faceb_3 = FaceBoundaries(Mesh=mesh_6)
boundary_3 = BoundarySurfaces(Edges=faceb_3)
join_3 = BrepJoin(Breps=boundary_3)  # -> Breps, Closed
mesh_7 = Mesh(reflay_8)

# ----
# TERRAIN
panel_12 = Panel("TopoMesh")
reflay_9 = ReferenceByLayer(LayerName=panel_12, lightweight=False, DisableAutoUpdate=False)
reflay_10 = ReferenceByLayer(LayerName="TopoBrep", lightweight=False, DisableAutoUpdate=False)
panel_13 = Panel([reflay_9, reflay_10])

reflay_11 = ReferenceByLayer(LayerName="Pods", lightweight=False, DisableAutoUpdate=False)
panel_14 = Panel(reflay_11)
mesh_8 = MeshBrep(
    Brep=reflay_11,
    Settings={GridMaxCount=0, GridMinCount=16, JaggedSeams=False, MaxEdgeLength=0, MinEdgeLength=0.0001, MinTolerance=0, Refine=True, RefineAngle=0, RelativeTolerance=0.65, SimplePlanes=True, Tolerance=0})
brep_4 = Brep(reflay_11)
mjoin_3 = MeshJoin(Meshes=mesh_8)
weld_3 = WeldMesh(Mesh=mjoin_3, Angle=3.141592654)

srf = Surface(<surface referenced from the Rhino model>)

# ----
# EDIT SITE MESH
panel_15 = Panel("https://macad.speckle.xyz/streams/4975f9f0a8/branches/site/04-community-site")
receive_2 = Receive(
    Stream=panel_15,
    AutoReceive=False,
    CurrentComponentState="expired",
    ExpandOutput=True,
    LastInfoMessage="James McBennett @ 03/01/2024 23:14:17: 2024 Mar-01 (id:9ec35295b2)",
    ReceiveOnOpen=False,
    ReceivedCommitId="9ec35295b2",
    StreamWrapper="https://macad.speckle.xyz/streams/4975f9f0a8/branches/site/04-community-site",
    selectedKitName="Objects")  # -> Info, CONTOURS, SOIL
item_5 = ListItem(List=flatten(receive_2.SOIL), Index=Slider(3, range=0..17), Wrap=True)
bbox = BoundingBox(Content=srf, Plane=PlaneXY(0, 0, 0))  # -> Box, Box_2
volume_3 = Volume(Geometry=bbox.Box)  # -> Volume, Centroid
msphere = MeshSphere(Base=volume_3.Centroid, Radius="80", UCount="100", VCount="100")
msplit = MeshSplit(Mesh=item_5, Splitters=msphere)

mmx = MeshMesh(MeshA=item_5, MeshB=msphere)
item_6 = ListItem(List=msplit, Index=Slider(0, range=0..1), Wrap=True)

# ---- group: LEVEL
floor_levels_2 = Text(floor_levels)

# ----
filter = StreamFilter(Gate=list_2, Stream0=reflay_10, Stream1=reflay_9)
msplit_2 = MeshSplit(Mesh=filter, Splitters=msphere)
item_7 = ListItem(List=msplit_2, Index=Slider(1, range=0..1), Wrap=True)
name = ExtendSpeckleObject(
    SpeckleObject=item_7,
    BIMSCPROJECT=bimsc_project,
    BIMSCORIGINATOR=bimsc_originator,
    BIMSCVOLUME=bimsc_volume,
    BIMSCLEVEL=floor_levels_2,
    BIMSCTYPE="TERRAIN",
    BIMSCMATERIAL="soil",
    RenderMaterial=dso.Soil,
    BIMSCPHASE=num_3,
    selectedKitName="Objects")  # -> flatten(ExtendedSpeckleObject)

# ---- group: LEVEL
floor_levels_3 = Text(floor_levels)

# ----
filter_2 = StreamFilter(Gate=list_2, Stream0=brep_2, Stream1=weld)
name_2 = ExtendSpeckleObject(
    SpeckleObject=filter_2,
    BIMSCPROJECT=bimsc_project,
    BIMSCORIGINATOR=bimsc_originator,
    BIMSCVOLUME=bimsc_volume,
    BIMSCLEVEL=floor_levels_3,
    BIMSCTYPE="FLOORS",
    BIMSCMATERIAL="Regolith",
    RenderMaterial=dso.Regolith,
    BIMSCPHASE=num_4,
    selectedKitName="Objects")  # -> flatten(ExtendedSpeckleObject)

# ---- group: LEVEL
floor_levels_4 = Text(floor_levels)

# ----
filter_3 = StreamFilter(Gate=list_2, Stream0=brep_4, Stream1=weld_3)
name_3 = ExtendSpeckleObject(
    SpeckleObject=filter_3,
    BIMSCPROJECT=bimsc_project,
    BIMSCORIGINATOR=bimsc_originator,
    BIMSCVOLUME=bimsc_volume,
    BIMSCLEVEL=floor_levels_4,
    BIMSCTYPE="PODS",
    BIMSCMATERIAL="Regolith",
    RenderMaterial=dso.Regolith,
    BIMSCPHASE=num_2,
    selectedKitName="Objects")  # -> flatten(ExtendedSpeckleObject)

# ---- group: LEVEL
floor_levels_5 = Text(floor_levels)

floor_levels_6 = Text(floor_levels)

txt = Text(Tree({0}: ["L00"], {1}: ["L04"]))

# ----
filter_4 = StreamFilter(Gate=list_2, Stream0=join_3.Breps, Stream1=mesh_7)  # -> reverse(simplify(graft(Stream)))
name_4 = ExtendSpeckleObject(
    SpeckleObject=filter_4,
    BIMSCPROJECT=bimsc_project,
    BIMSCORIGINATOR=bimsc_originator,
    BIMSCVOLUME=bimsc_volume,
    BIMSCLEVEL=txt,
    BIMSCTYPE="ROOF",
    BIMSCMATERIAL="Inflatable",
    RenderMaterial=dso.Inflatable,
    BIMSCPHASE=num_7,
    selectedKitName="Objects")

# ---- group: LEVEL
txt_2 = Text(Tree({0}: ["L00"], {1}: ["L04"]))

# ----
filter_5 = StreamFilter(Gate=list_2, Stream0=brep_3, Stream1=weld_2)  # -> reverse(simplify(graft(Stream)))
name_5 = ExtendSpeckleObject(
    SpeckleObject=filter_5,
    BIMSCPROJECT=bimsc_project,
    BIMSCORIGINATOR=bimsc_originator,
    BIMSCVOLUME=bimsc_volume,
    BIMSCLEVEL=txt_2,
    BIMSCTYPE="WALLS",
    BIMSCMATERIAL="Regolith",
    RenderMaterial=dso.Regolith,
    BIMSCPHASE=num_6,
    selectedKitName="Objects")

# ---- group: LEVEL
floor_levels_7 = Text(floor_levels)

# ----
name_6 = ExtendSpeckleObject(
    SpeckleObject=item_6,
    BIMSCPROJECT=bimsc_project,
    BIMSCORIGINATOR=bimsc_originator,
    BIMSCVOLUME=bimsc_volume,
    BIMSCLEVEL=floor_levels_7,
    BIMSCTYPE="SITE",
    BIMSCMATERIAL="soil",
    RenderMaterial=dso.Soil,
    BIMSCPHASE=num_3,
    selectedKitName="Objects")  # -> flatten(ExtendedSpeckleObject)
# SEND
# G06_test_Unreal
panel_16 = Panel("https://macad.speckle.xyz/streams/5e4e4e4563")
cso = CreateSpeckleObject(TERRAIN=name, selectedKitName="Objects")
cso_2 = CreateSpeckleObject(ROOF=name_4, WALL=name_5, FLOORS=name_2, PODS=name_3, TERRAIN=name, SITE_A4=name_6, selectedKitName="Objects")
send = Send(
    Stream=panel_16,
    Message="G06_AssembledModel_TERRAIN",
    D=cso,
    AutoSend=False,
    BaseId="ee0e14217002adec6b78cec722219f1f",
    CurrentComponentState="up_to_date",
    KitName="Objects",
    OutputWrappers="https://macad.speckle.xyz\t5e4e4e4563\tc495e350ee",
    UseDefaultCache=True,
    selectedKitName="Objects")
rec = DataRecorder(send, DataLimit=-10, RecordData=True)
panel_17 = Panel(rec)

number_slider_2 = Slider(1.5, range=1..2)
range = Range(Domain=Slider(1.5, range=0..6.002), Steps=number_slider_2)
range_2 = Range(Domain=Domain(0, 1), Steps=number_slider_2)
graph = GraphMapper(range_2, x0=0, x1=1, y0=0, y1=1, container_name="Bezier", cpx=[0, 0.5185281634, 1, 1], cpy=[0, 0, 0.1436586976, 1])
pt_2 = ConstructPoint(XCoordinate=0, YCoordinate=0, ZCoordinate=range)
dom = ConstructDomain(DomainStart=Slider(2, range=1..13), DomainEnd=Slider(0.7, range=0..2.02))
bnd_2 = Bounds(Numbers=graph)
prot = RotatePlane(Plane=pt_2, Angle="0.5*pi")
remap = RemapNumbers(Value=graph, Source=bnd_2, Target=dom)  # -> Mapped, Clipped
cir = Circle(Plane=pt_2, Radius=remap.Mapped)
item_8 = ListItem(List=cir, Index=0, Wrap=True)
area_2 = Area(Geometry=item_8)  # -> Area, Centroid
number_slider_3 = Slider(0.01, range=0..1)
range_3 = Range(Domain=Domain(0, 1), Steps=Slider(4, range=0..50))
shatter = Shatter(Curve=reparameterize(graft(cir)), Parameters=range_3)
subtraction_2 = Subtraction(A="1", B=number_slider_3)
merge = Merge(Data1="0", Data2=number_slider_3, Data3=subtraction_2, Data4="1")
consec = ConsecutiveDomains(Numbers=merge, Additive=invert(True))
panel_18 = Panel(merge)
subcrv = SubCurve(BaseCurve=reparameterize(graft(shatter)), Domain=consec)
panel_19 = Panel("""0
2""")
panel_20 = Panel(consec)
cull_i = CullIndex(List=subcrv, Indices=panel_19, Wrap=True)  # -> simplify(List)
item_9 = ListItem(List=subcrv, Index=panel_19, Wrap=True)
pshift = ShiftPaths(Data=cull_i, Offset=-1)
flip = FlipMatrix(Data=pshift)
midpt = CurveMiddle(Curve=flip)
loft = Loft(Curves=cir, Options={Adjust=False, Closed=False, LoftEnds=0, LoftSimp=0, LoftType=0, Rebuild=10, Refit=0.01})
pshift_2 = ShiftPaths(Data=item_9, Offset=-1)
graph_2 = GraphMapper(range_2, x0=0, x1=1, y0=0, y1=1, container_name="Bezier", cpx=[0, 0.25, 0.75, 1], cpy=[0, 0.25, 0.75, 1])
join_4 = JoinCurves(Curves=pshift_2, Preserve=False)
brep_cp = BrepClosestPoint(Point=midpt, Brep=loft)  # -> Point, Normal, Distance
dom_2 = ConstructDomain(DomainStart=Slider(0.1, range=0..10), DomainEnd=Slider(0.11, range=0..1))
flip_2 = FlipMatrix(Data=join_4)
bnd_3 = Bounds(Numbers=graph_2)
remap_2 = RemapNumbers(Value=graph_2, Source=bnd_3, Target=dom_2)  # -> Mapped, Clipped
amp = Amplitude(Vector=brep_cp.Normal, Amplitude=remap_2.Mapped)
rev = Reverse(Vector=amp)
end_3 = EndPoints(Curve=flip)  # -> Start, End
move_2 = Move(Geometry=midpt, Motion=rev)  # -> Geometry, Transform
arc = Arc3Pt(PointA=end_3.Start, PointB=move_2.Geometry, PointC=end_3.End)  # -> Arc, Plane, Radius
item_10 = ListItem(List=arc.Arc, Index=0, Wrap=True)
project_2 = Project(Geometry=item_10, Plane=PlaneXY(0, 0, 0))  # -> Geometry, Transform
loft_opt = LoftOptions(Closed=False, Adjust=False, Rebuild=0, Refit="0.01", Type=0)
replace = ReplaceItems(List=arc.Arc, Item=project_2.Geometry, Indices="0", Wrap=False)
loft_2 = Loft(Curves=flip_2, Options=loft_opt)
loft_3 = Loft(Curves=replace, Options=loft_opt)
entwine = Entwine(Branch00=loft_3, Branch01=loft_2, FlattenInputs=True)
brep_5 = Brep(item_2)
merge_2 = Merge(Data1=ColourSwatch(SwatchColor=RGBA(107, 107, 107, 206)), Data2=ColourSwatch(SwatchColor=RGB(255, 255, 255)))  # -> simplify(graft(Result))
python = GhPythonScript(S=entwine, D=Slider(0.01, range=0..1))  # -> simplify(a); inputs S: Brep
# ---------- python: Python ----------
import rhinoscriptsyntax as rs

a = rs.OffsetSurface(S, D, None, False, True)
# ---------- end python ----------
flatten = FlattenTree(Tree=python, Path="{0}")

Z_3 = UnitZ(Factor=expr("-x", Slider(0.1, range=0..10)))
item_11 = ListItem(List=cir, Index="-1", Wrap=True)
extr_2 = Extrude(Base=item_11, Direction=Z_3)
cap_2 = CapHoles(Brep=extr_2)

item_12 = ListItem(List=brep_5, Index=0, Wrap=True)

volume_4 = Volume(Geometry=item_12)  # -> Volume, Centroid
move2pt = MoveToPoint(Geometry=flatten, PointA=area_2.Centroid, PointB=graft(volume_4.Centroid))  # -> simplify(Moved), Vector, Transform
lng = ListLength(List=move2pt.Moved)
graft = GraftTree(Tree=volume_4.Centroid, IncludeEmptyLists=True, IncludeNullItems=True)  # -> simplify(Tree)
group_4 = Group(Objects=move2pt.Moved)
split_2 = SplitList(List=move2pt.Moved, Index=expr("x/2", lng))  # -> flatten(ListA), flatten(ListB)
mirror = Mirror(Geometry=group_4, Plane=graft)  # -> Geometry, Transform
ungroup = Ungroup(Group=mirror.Geometry)
move2pt_2 = MoveToPoint(Geometry=cap_2, PointA=area_2.Centroid, PointB=graft(volume_4.Centroid))  # -> Moved, Vector, Transform
entwine_2 = Entwine(Branch00=split_2.ListA, Branch01=split_2.ListB, FlattenInputs=True)  # -> simplify(Result)
split_3 = SplitList(List=ungroup, Index=expr("x/2", lng))  # -> flatten(ListA), flatten(ListB)
entwine_3 = Entwine(Branch00=split_3.ListA, Branch01=split_3.ListB, FlattenInputs=True)  # -> simplify(Result)
merge_3 = Merge(Data1=entwine_2, Data2=entwine_3)

data = Data([split_2.ListA, split_3.ListA])
data_2 = Data([split_2.ListB, split_3.ListB])
qrmesh = QuadRemesh(Mesh=data, Settings={aqc=True, as=50, dhe=True, gci=0, null=False, pme=0, sa=0, tqc=2000})  # -> graft(QuadResult)
qrmesh_2 = QuadRemesh(Mesh=data_2, Settings={aqc=True, as=50, dhe=True, gci=0, null=False, pme=0, sa=0, tqc=2000})

# ---- group: unit centroid
pt_3 = Point(volume_4.Centroid)

# ----
group_5 = Group(Objects=qrmesh_2)
group_6 = Group(Objects=qrmesh)
group_7 = Group(Objects=flatten([group_5, group_2]))
move2pt_3 = MoveToPoint(Geometry=move2pt_2.Moved, PointA=pt_3, PointB=pt)  # -> flatten(Moved), Vector, Transform
move2pt_4 = MoveToPoint(Geometry=qrmesh_2, PointA=pt_3, PointB=graft(pt))  # -> flatten(Moved), Vector, Transform
move2pt_5 = MoveToPoint(Geometry=qrmesh, PointA=pt_3, PointB=pt)  # -> flatten(Moved), Vector, Transform
merge_4 = Merge(Data1=move2pt_3.Moved, Data2=move2pt_4.Moved)

number_slider_4 = Slider(1.5, range=1..2)
range_4 = Range(Domain=Slider(3.7, range=0..6.002), Steps=number_slider_4)
range_5 = Range(Domain=Domain(0, 1), Steps=number_slider_4)
graph_3 = GraphMapper(range_5, x0=0, x1=1, y0=0, y1=1, container_name="Bezier", cpx=[0, 0.5185281634, 1, 1], cpy=[0, 0, 0.1436586976, 1])
pt_4 = ConstructPoint(XCoordinate=0, YCoordinate=0, ZCoordinate=range_4)
dom_3 = ConstructDomain(DomainStart=Slider(4.2, range=1..13), DomainEnd=Slider(1.2, range=0..2.02))
bnd_4 = Bounds(Numbers=graph_3)
prot_2 = RotatePlane(Plane=pt_4, Angle="0.5*pi")
remap_3 = RemapNumbers(Value=graph_3, Source=bnd_4, Target=dom_3)  # -> Mapped, Clipped
cir_2 = Circle(Plane=prot_2, Radius=remap_3.Mapped)
item_13 = ListItem(List=cir_2, Index=0, Wrap=True)
area_3 = Area(Geometry=item_13)  # -> Area, Centroid
number_slider_5 = Slider(0.01, range=0..1)
range_6 = Range(Domain=Domain(0, 1), Steps=Slider(8, range=0..50))
shatter_2 = Shatter(Curve=reparameterize(graft(cir_2)), Parameters=range_6)
subtraction_3 = Subtraction(A="1", B=number_slider_5)
merge_5 = Merge(Data1="0", Data2=number_slider_5, Data3=subtraction_3, Data4="1")
consec_2 = ConsecutiveDomains(Numbers=merge_5, Additive=invert(True))
panel_21 = Panel(merge_5)
subcrv_2 = SubCurve(BaseCurve=reparameterize(graft(shatter_2)), Domain=consec_2)
panel_22 = Panel("""0
2""")
panel_23 = Panel(consec_2)
cull_i_2 = CullIndex(List=subcrv_2, Indices=panel_22, Wrap=True)  # -> simplify(List)
item_14 = ListItem(List=subcrv_2, Index=panel_22, Wrap=True)
pshift_3 = ShiftPaths(Data=cull_i_2, Offset=-1)
flip_3 = FlipMatrix(Data=pshift_3)
midpt_2 = CurveMiddle(Curve=flip_3)
loft_4 = Loft(Curves=cir_2, Options={Adjust=False, Closed=False, LoftEnds=0, LoftSimp=0, LoftType=0, Rebuild=10, Refit=0.01})
pshift_4 = ShiftPaths(Data=item_14, Offset=-1)
graph_4 = GraphMapper(range_5, x0=0, x1=1, y0=0, y1=1, container_name="Bezier", cpx=[0, 0.25, 0.75, 1], cpy=[0, 0.25, 0.75, 1])
join_5 = JoinCurves(Curves=pshift_4, Preserve=False)
brep_cp_2 = BrepClosestPoint(Point=midpt_2, Brep=loft_4)  # -> Point, Normal, Distance
dom_4 = ConstructDomain(DomainStart=Slider(0.1, range=0..10), DomainEnd=Slider(0.11, range=0..1))
flip_4 = FlipMatrix(Data=join_5)
bnd_5 = Bounds(Numbers=graph_4)
remap_4 = RemapNumbers(Value=graph_4, Source=bnd_5, Target=dom_4)  # -> Mapped, Clipped
amp_2 = Amplitude(Vector=brep_cp_2.Normal, Amplitude=remap_4.Mapped)
rev_2 = Reverse(Vector=amp_2)
end_4 = EndPoints(Curve=flip_3)  # -> Start, End
move_3 = Move(Geometry=midpt_2, Motion=rev_2)  # -> Geometry, Transform
arc_2 = Arc3Pt(PointA=end_4.Start, PointB=move_3.Geometry, PointC=end_4.End)  # -> Arc, Plane, Radius
item_15 = ListItem(List=arc_2.Arc, Index=0, Wrap=True)
project_3 = Project(Geometry=item_15, Plane=PlaneXY(0, 0, 0))  # -> Geometry, Transform
loft_opt_2 = LoftOptions(Closed=False, Adjust=False, Rebuild=0, Refit="0.01", Type=0)
replace_2 = ReplaceItems(List=arc_2.Arc, Item=project_3.Geometry, Indices="0", Wrap=False)
loft_5 = Loft(Curves=flip_4, Options=loft_opt_2)
loft_6 = Loft(Curves=replace_2, Options=loft_opt_2)
entwine_4 = Entwine(Branch00=loft_6, Branch01=loft_5, FlattenInputs=True)
merge_6 = Merge(Data1=ColourSwatch(SwatchColor=RGBA(107, 107, 107, 206)), Data2=ColourSwatch(SwatchColor=RGB(255, 255, 255)))  # -> simplify(graft(Result))
python_2 = GhPythonScript(S=entwine_4, D=Slider(0.01, range=0..1))  # -> simplify(a); inputs S: Brep; same code as python
brep_6 = Brep(cap)
flatten_2 = FlattenTree(Tree=python_2, Path="{0}")

Z_4 = UnitZ(Factor=expr("-x", Slider(0.1, range=0..10)))
item_16 = ListItem(List=cir_2, Index="-1", Wrap=True)
extr_3 = Extrude(Base=item_16, Direction=Z_4)
cap_3 = CapHoles(Brep=extr_3)

item_17 = ListItem(List=flatten(brep_6), Index=0, Wrap=True)

volume_5 = Volume(Geometry=item_17)  # -> Volume, Centroid
move2pt_6 = MoveToPoint(Geometry=flatten_2, PointA=area_3.Centroid, PointB=graft(volume_5.Centroid))  # -> simplify(Moved), Vector, Transform
lng_2 = ListLength(List=move2pt_6.Moved)
graft_2 = GraftTree(Tree=volume_5.Centroid, IncludeEmptyLists=True, IncludeNullItems=True)  # -> simplify(Tree)
group_8 = Group(Objects=move2pt_6.Moved)
split_4 = SplitList(List=move2pt_6.Moved, Index=expr("x/2", lng_2))  # -> flatten(ListA), flatten(ListB)
mirror_2 = Mirror(Geometry=group_8, Plane=graft_2)  # -> Geometry, Transform
ungroup_2 = Ungroup(Group=mirror_2.Geometry)
move2pt_7 = MoveToPoint(Geometry=cap_3, PointA=area_3.Centroid, PointB=graft(volume_5.Centroid))  # -> Moved, Vector, Transform
entwine_5 = Entwine(Branch00=split_4.ListA, Branch01=split_4.ListB, FlattenInputs=True)  # -> simplify(Result)
split_5 = SplitList(List=ungroup_2, Index=expr("x/2", lng_2))  # -> flatten(ListA), flatten(ListB)
entwine_6 = Entwine(Branch00=split_5.ListA, Branch01=split_5.ListB, FlattenInputs=True)  # -> simplify(Result)
merge_7 = Merge(Data1=entwine_5, Data2=entwine_6)

volume_6 = Volume(Geometry=brep_6)  # -> Volume, Centroid
data_3 = Data([split_4.ListA, split_5.ListA])
data_4 = Data([split_4.ListB, split_5.ListB])
qrmesh_3 = QuadRemesh(Mesh=data_4, Settings={aqc=True, as=50, dhe=True, gci=0, null=False, pme=0, sa=0, tqc=2000})
qrmesh_4 = QuadRemesh(Mesh=data_3, Settings={aqc=True, as=50, dhe=True, gci=0, null=False, pme=0, sa=0, tqc=2000})  # -> graft(QuadResult)

# ---- group: units centroids
pt_5 = Point(flatten(volume_6.Centroid))

# ---- group: unit centroid
pt_6 = Point(volume_5.Centroid)

# ----
group_9 = Group(Objects=qrmesh_3)
group_10 = Group(Objects=qrmesh_4)
group_11 = Group(Objects=flatten([group_9, group_3]))
move2pt_8 = MoveToPoint(Geometry=qrmesh_3, PointA=pt_6, PointB=graft(pt_5))  # -> flatten(Moved), Vector, Transform
move2pt_9 = MoveToPoint(Geometry=[move2pt_7.Moved, qrmesh_3], PointA=pt_6, PointB=pt_5)  # -> flatten(Moved), Vector, Transform
move2pt_10 = MoveToPoint(Geometry=qrmesh_4, PointA=pt_6, PointB=pt_5)  # -> flatten(Moved), Vector, Transform
merge_8 = Merge(Data1=move2pt_8.Moved, Data2=move2pt_9.Moved)

number_slider_6 = Slider(1.5, range=1..2)
range_7 = Range(Domain=Slider(1.5, range=0..6.002), Steps=number_slider_6)
range_8 = Range(Domain=Domain(0, 1), Steps=number_slider_6)
graph_5 = GraphMapper(range_8, x0=0, x1=1, y0=0, y1=1, container_name="Bezier", cpx=[0, 0.5185281634, 1, 1], cpy=[0, 0, 0.1436586976, 1])
pt_7 = ConstructPoint(XCoordinate=0, YCoordinate=0, ZCoordinate=range_7)
dom_5 = ConstructDomain(DomainStart=Slider(3.9, range=1..13), DomainEnd=Slider(1.2, range=0..2.02))
bnd_6 = Bounds(Numbers=graph_5)
prot_3 = RotatePlane(Plane=pt_7, Angle="0.5*pi")
remap_5 = RemapNumbers(Value=graph_5, Source=bnd_6, Target=dom_5)  # -> Mapped, Clipped
number_slider_7 = Slider(0.01, range=0..1)
cir_3 = Circle(Plane=prot_3, Radius=remap_5.Mapped)
item_18 = ListItem(List=cir_3, Index=0, Wrap=True)
area_4 = Area(Geometry=item_18)  # -> Area, Centroid
subtraction_4 = Subtraction(A="1", B=number_slider_7)
range_9 = Range(Domain=Domain(0, 1), Steps=Slider(8, range=0..50))
merge_9 = Merge(Data1="0", Data2=number_slider_7, Data3=subtraction_4, Data4="1")
shatter_3 = Shatter(Curve=reparameterize(graft(cir_3)), Parameters=range_9)
consec_3 = ConsecutiveDomains(Numbers=merge_9, Additive=invert(True))
panel_24 = Panel(merge_9)
subcrv_3 = SubCurve(BaseCurve=reparameterize(graft(shatter_3)), Domain=consec_3)
panel_25 = Panel("""0
2""")
panel_26 = Panel(consec_3)
cull_i_3 = CullIndex(List=subcrv_3, Indices=panel_25, Wrap=True)  # -> simplify(List)
item_19 = ListItem(List=subcrv_3, Index=panel_25, Wrap=True)
pshift_5 = ShiftPaths(Data=cull_i_3, Offset=-1)
flip_5 = FlipMatrix(Data=pshift_5)
midpt_3 = CurveMiddle(Curve=flip_5)
loft_7 = Loft(Curves=cir_3, Options={Adjust=False, Closed=False, LoftEnds=0, LoftSimp=0, LoftType=0, Rebuild=10, Refit=0.01})
pshift_6 = ShiftPaths(Data=item_19, Offset=-1)
graph_6 = GraphMapper(range_8, x0=0, x1=1, y0=0, y1=1, container_name="Bezier", cpx=[0, 0.25, 0.75, 1], cpy=[0, 0.25, 0.75, 1])
join_6 = JoinCurves(Curves=pshift_6, Preserve=False)
brep_cp_3 = BrepClosestPoint(Point=midpt_3, Brep=loft_7)  # -> Point, Normal, Distance
dom_6 = ConstructDomain(DomainStart=Slider(0.1, range=0..10), DomainEnd=Slider(0.11, range=0..1))
flip_6 = FlipMatrix(Data=join_6)
bnd_7 = Bounds(Numbers=graph_6)
remap_6 = RemapNumbers(Value=graph_6, Source=bnd_7, Target=dom_6)  # -> Mapped, Clipped
amp_3 = Amplitude(Vector=brep_cp_3.Normal, Amplitude=remap_6.Mapped)
rev_3 = Reverse(Vector=amp_3)
end_5 = EndPoints(Curve=flip_5)  # -> Start, End
move_4 = Move(Geometry=midpt_3, Motion=rev_3)  # -> Geometry, Transform
arc_3 = Arc3Pt(PointA=end_5.Start, PointB=move_4.Geometry, PointC=end_5.End)  # -> Arc, Plane, Radius
item_20 = ListItem(List=arc_3.Arc, Index=0, Wrap=True)
project_4 = Project(Geometry=item_20, Plane=PlaneXY(0, 0, 0))  # -> Geometry, Transform
loft_opt_3 = LoftOptions(Closed=False, Adjust=False, Rebuild=0, Refit="0.01", Type=0)
replace_3 = ReplaceItems(List=arc_3.Arc, Item=project_4.Geometry, Indices="0", Wrap=False)
loft_8 = Loft(Curves=flip_6, Options=loft_opt_3)
loft_9 = Loft(Curves=replace_3, Options=loft_opt_3)
entwine_7 = Entwine(Branch00=loft_9, Branch01=loft_8, FlattenInputs=True)
merge_10 = Merge(Data1=ColourSwatch(SwatchColor=RGBA(189, 189, 189, 206)), Data2=ColourSwatch(SwatchColor=RGB(255, 255, 255)))  # -> simplify(graft(Result))
python_3 = GhPythonScript(S=entwine_7, D=Slider(0.01, range=0..1))  # -> simplify(a); inputs S: Brep; same code as python
brep_7 = Brep(item_3)
volume_7 = Volume(Geometry=brep_7)  # -> Volume, Centroid
flatten_3 = FlattenTree(Tree=python_3, Path="{0}")
move2pt_11 = MoveToPoint(Geometry=flatten_3, PointA=area_4.Centroid, PointB=graft(volume_7.Centroid))  # -> simplify(Moved), Vector, Transform
lng_3 = ListLength(List=move2pt_11.Moved)
graft_3 = GraftTree(Tree=volume_7.Centroid, IncludeEmptyLists=True, IncludeNullItems=True)  # -> simplify(Tree)
group_12 = Group(Objects=move2pt_11.Moved)
split_6 = SplitList(List=move2pt_11.Moved, Index=expr("x/2", lng_3))  # -> flatten(ListA), flatten(ListB)
mirror_3 = Mirror(Geometry=group_12, Plane=graft_3)  # -> Geometry, Transform
brep_8 = Brep(split.Negative)
ungroup_3 = Ungroup(Group=mirror_3.Geometry)
entwine_8 = Entwine(Branch00=split_6.ListA, Branch01=split_6.ListB, FlattenInputs=True)  # -> simplify(Result)
split_7 = SplitList(List=ungroup_3, Index=expr("x/2", lng_3))  # -> flatten(ListA), flatten(ListB)
volume_8 = Volume(Geometry=brep_8)  # -> Volume, Centroid
cull_i_4 = CullIndex(List=volume_8.Centroid, Indices="0", Wrap=True)
entwine_9 = Entwine(Branch00=split_7.ListA, Branch01=split_7.ListB, FlattenInputs=True)  # -> simplify(Result)
merge_11 = Merge(Data1=entwine_8, Data2=entwine_9)

Z_5 = UnitZ(Factor=expr("-x", Slider(0.1, range=0..10)))
item_21 = ListItem(List=cir_3, Index="-1", Wrap=True)
extr_4 = Extrude(Base=item_21, Direction=Z_5)
cap_4 = CapHoles(Brep=extr_4)

move2pt_12 = MoveToPoint(Geometry=cap_4, PointA=area_4.Centroid, PointB=graft(volume_7.Centroid))  # -> Moved, Vector, Transform

data_5 = Data([split_6.ListB, split_7.ListB])
data_6 = Data([split_6.ListA, split_7.ListA])
qrmesh_5 = QuadRemesh(Mesh=data_5, Settings={aqc=True, as=50, dhe=True, gci=0, null=False, pme=0, sa=0, tqc=2000})
qrmesh_6 = QuadRemesh(Mesh=data_6, Settings={aqc=True, as=50, dhe=True, gci=0, null=False, pme=0, sa=0, tqc=2000})  # -> graft(QuadResult)

# ---- group: unit centroid
pt_8 = Point(volume_7.Centroid)

# ---- group: units centroids
pt_9 = Point(volume_8.Centroid)

# ----
group_13 = Group(Objects=qrmesh_5)
group_14 = Group(Objects=qrmesh_6)
group_15 = Group(Objects=flatten([group_13, group]))
move2pt_13 = MoveToPoint(Geometry=qrmesh_5, PointA=pt_8, PointB=graft(pt_9))  # -> flatten(Moved), Vector, Transform
move2pt_14 = MoveToPoint(Geometry=move2pt_12.Moved, PointA=pt_8, PointB=pt_9)  # -> flatten(Moved), Vector, Transform
move2pt_15 = MoveToPoint(Geometry=qrmesh_6, PointA=pt_8, PointB=pt_9)  # -> flatten(Moved), Vector, Transform
merge_12 = Merge(Data1=move2pt_14.Moved, Data2=move2pt_13.Moved)

filter_6 = StreamFilter(Gate=list_2, Stream1=[move2pt_10.Moved, move2pt_15.Moved, move2pt_5.Moved])
name_7 = ExtendSpeckleObject(
    SpeckleObject=filter_6,
    BIMSCPROJECT=bimsc_project,
    BIMSCORIGINATOR=bimsc_originator,
    BIMSCVOLUME=bimsc_volume,
    BIMSCLEVEL=floor_levels_6,
    BIMSCTYPE="UNITS INFLATABLE",
    BIMSCMATERIAL="Inflatable",
    RenderMaterial=dso.Insulation,
    BIMSCPHASE=num_5,
    selectedKitName="Objects")  # -> flatten(ExtendedSpeckleObject)

filter_7 = StreamFilter(Gate=list_2, Stream1=[merge_8, merge_12, merge_4])
name_8 = ExtendSpeckleObject(
    SpeckleObject=filter_7,
    BIMSCPROJECT=bimsc_project,
    BIMSCORIGINATOR=bimsc_originator,
    BIMSCVOLUME=bimsc_volume,
    BIMSCLEVEL=floor_levels_5,
    BIMSCTYPE="UNIT STRUCTURE",
    BIMSCMATERIAL="Steel",
    RenderMaterial=dso.Steel,
    BIMSCPHASE=num,
    selectedKitName="Objects")  # -> flatten(ExtendedSpeckleObject)

# ----
# SEND
# G06_test_Unreal
# g06 wip branch
# https://macad.speckle.xyz/streams/4975f9f0a8/branches/wip%2Fg06
# g06 shared branch
# https://macad.speckle.xyz/streams/4975f9f0a8/branches/shared%2Fg06
panel_27 = Panel("https://macad.speckle.xyz/streams/5e4e4e4563")
cso_3 = CreateSpeckleObject(
    ROOF=name_4,
    WALL=name_5,
    FLOORS=name_2,
    PODS=name_3,
    UNITSINFLATABLES=name_7,
    UNITSTRUCTURE=name_8,
    TERRAIN=name,
    SITE_A4=name_6,
    selectedKitName="Objects")
send_2 = Send(
    Stream=panel_27,
    Message="G06_AssembledModel_V4",
    D=cso_3,
    AutoSend=False,
    BaseId="47242db80450f95d2e503483d19a1381",
    CurrentComponentState="expired",
    KitName="Objects",
    OutputWrappers="https://macad.speckle.xyz\t5e4e4e4563\teb524cad34",
    UseDefaultCache=True,
    selectedKitName="Objects")
rec_2 = DataRecorder(send_2, DataLimit=-10, RecordData=True)
panel_28 = Panel(rec_2)

cso_4 = CreateSpeckleObject(UNITSINFLATABLES=name_7, UNITSTRUCTURE=name_8, selectedKitName="Objects")
